# Grasshopper definition co2-wall-configurator.gh (Grasshopper 1.0.7)
# plug-ins: jSwan, ShapeDiverForGrasshopper, Swiftlet

panel = Panel("https://cyz7bkwwhl.execute-api.us-west-2.amazonaws.com/dev/getmaterialsapi")
get = GETRequest(URL=panel)  # -> Status, Content, Response
sddp = ShapeDiverDocumentPayload({AbsoluteTolerance=0, AngleTolerance=0, DistanceDisplayPrecision=0, GltfVersion="Gltf2", GrasshopperVersion="1.0.0007", InputGroups="{}", OutputGroups="{}", RelativeTolerance=0, RhinoVersion="7.34.23267.11001", UnitSystem=0, VersionCreated="1.17.0.0", VersionSaved="1.17.0.0"})

json_data_table = Data(get.Content)
deserialize_json = DeserializeJson(JSON=json_data_table, OutputsLocked=False)  # -> Materials, UserMaterials
deserialize_json_2 = DeserializeJson(JSON=deserialize_json.Materials, OutputsLocked=False)  # -> Unit, Densitykgm3, DataValidityYear, EPDsource, Producer, Name, EPDlink, LongName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
tmatch = MatchText(Text=deserialize_json_2.Unit, Pattern="m3", Case=True)
dispatch = Dispatch(List=deserialize_json_2.Gwp, DispatchPattern=tmatch)  # -> ListA, ListB
dispatch_2 = Dispatch(List=deserialize_json_2.Name, DispatchPattern=tmatch)  # -> ListA, ListB
data = Data(dispatch.ListA)
deserialize_json_3 = DeserializeJson(JSON=data, OutputsLocked=False)  # -> D, A1A2A3, C1, B1, C2, B2, C3, B3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
data_2 = Data(deserialize_json_3.C3)
data_3 = Data(deserialize_json_3.C4)
data_4 = Data(deserialize_json_3.A1A2A3)
addition = Addition(A=data_4, B=data_2, C=data_3)
data_5 = Data(addition)
data_6 = Data(dispatch_2.ListA)

_01_material = ValueList({"XPS", "EPS grey 15", "Concrete C50/60", "Concrete C25/30", "Rock wool (high)", "KVH", "High density fubreboard", "EPS white 30", "Concrete C35/45", "Medium density fibreboard"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}, selected="Porous brick")
_02_material = ValueList({"XPS", "EPS grey 15", "Concrete C50/60", "Concrete C25/30", "Rock wool (high)", "KVH", "High density fubreboard", "EPS white 30", "Concrete C35/45", "Medium density fibreboard"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}, selected="EPS grey 15")
_03_material = ValueList({"XPS", "EPS grey 15", "Concrete C50/60", "Concrete C25/30", "Rock wool (high)", "KVH", "High density fubreboard", "EPS white 30", "Concrete C35/45", "Medium density fibreboard"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}, selected="Fired brick")
_04_material = ValueList({"XPS", "EPS grey 15", "Concrete C50/60", "Concrete C25/30", "Rock wool (high)", "KVH", "High density fubreboard", "EPS white 30", "Concrete C35/45", "Medium density fibreboard"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}, selected="XPS")
number_of_layers = Slider(3, range=1..4)
_01_material_thickness = Slider(0.18, range=0..1)
_02_material_thickness = Slider(0.26, range=0..1)
_03_material_thickness = Slider(0.16, range=0..1)
_04_material_thickness = Slider(0.14, range=0..1)
_01_material_color = ColourSwatch(SwatchColor=RGB(212, 112, 112))
_02_material_color = ColourSwatch(SwatchColor=RGB(128, 128, 128))
_03_material_color = ColourSwatch(SwatchColor=RGB(168, 44, 44))
_04_material_color = ColourSwatch(SwatchColor=RGB(146, 213, 240))

number_slider = Slider(1, range=0..1)
number_slider_2 = Slider(1, range=0..1)
pt = ConstructPoint(XCoordinate=0, YCoordinate=0, ZCoordinate=0)
pt_2 = ConstructPoint(XCoordinate=number_slider, YCoordinate=0, ZCoordinate=number_slider_2)
pt_3 = ConstructPoint(XCoordinate=0, YCoordinate=0, ZCoordinate=number_slider_2)
pt_4 = ConstructPoint(XCoordinate=number_slider, YCoordinate=0, ZCoordinate=0)
srf4pt = _4PointSurface(CornerA=pt, CornerB=pt_4, CornerC=pt_2, CornerD=pt_3)

data_7 = Data(_01_material_thickness)
data_8 = Data(_02_material_thickness)
data_9 = Data(_04_material_thickness)
data_10 = Data(_03_material_thickness)
merge = Merge(Data1=data_7, Data2=data_8, Data3=data_10, Data4=data_9)
split = SplitList(List=merge, Index=number_of_layers)  # -> ListA, ListB
ma = MassAddition(Input=split.ListA)  # -> Result, PartialResults
multiplication = Multiplication(A=split.ListA, B=-1)

# ---- group: Generate wall geometry
data_11 = Data(multiplication)
data_12 = Data(ma.PartialResults)
geo = Geometry(srf4pt)
multiplication_2 = Multiplication(A=data_12, B=-1)
Y = UnitY(Factor=multiplication_2)
move = Move(Geometry=geo, Motion=Y)  # -> Geometry, Transform
subtraction = Subtraction(A=number_of_layers, B=1)
split_2 = SplitList(List=move.Geometry, Index=subtraction)  # -> ListA, ListB
merge_2 = Merge(Data1=geo, Data2=split_2.ListA)  # -> flatten(Result)
Y_2 = UnitY(Factor=data_11)
extr = Extrude(Base=merge_2, Direction=Y_2)
data_13 = Data(extr)
data_14 = Data(move.Geometry)

# ---- group: Generate positions for text
area = Area(Geometry=data_14)  # -> Area, Centroid
pdecon = Deconstruct(Point=area.Centroid)  # -> XComponent, YComponent, ZComponent
series = Series(Start=0, Step=Slider(0.1, range=0..0.1), Count=number_of_layers)
multiplication_3 = Multiplication(A=series, B=-1)
addition_2 = Addition(A=pdecon.XComponent, B=Slider(1, range=0..1))
addition_3 = Addition(A=pdecon.YComponent, B=multiplication_3)
pt_5 = ConstructPoint(XCoordinate=addition_2, YCoordinate=addition_3, ZCoordinate=pdecon.ZComponent)

# ---- group: Set material data
data_15 = Data(data_5)
data_16 = Data(data_6)
find_epd_index = FindEPDIndex(text=_01_material, data_to_search=data_16)
find_epd_index_2 = FindEPDIndex(text=_02_material, data_to_search=data_16)
find_epd_index_3 = FindEPDIndex(text=_04_material, data_to_search=data_16)
find_epd_index_4 = FindEPDIndex(text=_03_material, data_to_search=data_16)
item = ListItem(List=data_15, Index=find_epd_index, Wrap=True)
item_2 = ListItem(List=data_15, Index=find_epd_index_2, Wrap=True)
item_3 = ListItem(List=data_15, Index=find_epd_index_3, Wrap=True)
item_4 = ListItem(List=data_15, Index=find_epd_index_4, Wrap=True)
item_5 = ListItem(List=item_4, Index=0, Wrap=True)
item_6 = ListItem(List=item, Index=0, Wrap=True)
item_7 = ListItem(List=item_2, Index=0, Wrap=True)
item_8 = ListItem(List=item_3, Index=0, Wrap=True)
merge_3 = Merge(Data1=item_6, Data2=item_7, Data3=item_5, Data4=item_8)

# ----
split_3 = SplitList(List=merge, Index=number_of_layers)  # -> ListA, ListB
split_4 = SplitList(List=merge_3, Index=number_of_layers)  # -> ListA, ListB
multiplication_4 = Multiplication(A=split_4.ListA, B=split_3.ListA)

# ---- group: Generate positions for lines
pdecon_2 = Deconstruct(Point=area.Centroid)  # -> XComponent, YComponent, ZComponent
addition_4 = Addition(A=pdecon_2.XComponent, B=Slider(0.5, range=0..1))
division = Division(A=split_3.ListA, B=2)
addition_5 = Addition(A=pdecon_2.YComponent, B=division)
pt_6 = ConstructPoint(XCoordinate=addition_4, YCoordinate=addition_5, ZCoordinate=pdecon_2.ZComponent)

# ---- group: Set text for layers
round = Round(Number=multiplication_4)  # -> Nearest, Floor, Ceiling
merge_4 = Merge(Data1=_01_material, Data2=_02_material, Data3=_03_material, Data4=_04_material)
concat = Concatenate(FragmentA=merge_4, FragmentB=": ", FragmentC=round.Nearest, FragmentD=" kgCO2")
split_5 = SplitList(List=concat, Index=number_of_layers)  # -> ListA, ListB

# ---- group: Set text for total value
ma_2 = MassAddition(Input=multiplication_4)  # -> Result, PartialResults
round_2 = Round(Number=ma_2.Result)  # -> Nearest, Floor, Ceiling
concat_2 = Concatenate(FragmentA="Total result:", FragmentB="  ", FragmentC=round_2.Nearest, FragmentD=" kgCO2")

# ----
pt_7 = ConstructPoint(XCoordinate="1", YCoordinate="0.5", ZCoordinate="0.5")

data_17 = Data(data_13)

# ---- group: Material colors
sdmaterial = LegacyMaterial(Color=_01_material_color, FlatShading=False)
sdmaterial_2 = LegacyMaterial(Color=_02_material_color, FlatShading=False)
sdmaterial_3 = LegacyMaterial(Color=_03_material_color, FlatShading=False)
sdmaterial_4 = LegacyMaterial(Color=_04_material_color, FlatShading=False)
item_9 = ListItem(List=data_17, Index=0, Wrap=Toggle(False))  # -> Item, Item1, Item2, Item3
sddisplay = LegacyDisplay(Geometry=item_9.Item1, ShapeDiverMaterial=sdmaterial_2)
sddisplay_2 = LegacyDisplay(Geometry=item_9.Item3, ShapeDiverMaterial=sdmaterial_4)
sddisplay_3 = LegacyDisplay(Geometry=item_9.Item2, ShapeDiverMaterial=sdmaterial_3)
sddisplay_4 = LegacyDisplay(Geometry=item_9.Item, ShapeDiverMaterial=sdmaterial)

# ---- group: Data export
encoding = ValueList({"ASCII", "UTF_8", "UTF_8_NO_BOM"}, selected="ASCII")
end_of_line = ValueList({"CRLF", "LF", "CR"}, selected="CRLF")
extension = ValueList({"txt", "g", "gcode", "csv", "xml", "json", "ifc"}, selected="txt")
merge_5 = Merge(Data1=flatten(concat_2), Data2=flatten(split_5.ListA))
exporttxt = TextExportOptions(Extension=extension, EndOfLine=end_of_line, Encoding=encoding, N=False)
downloadexport = DownloadExport(Data=merge_5, Options=exporttxt, Name="results")

# ---- group: Print text and lines
wires = BrepWireframe(Brep=flatten(data_17), Density=-1)
main_color = ColourSwatch(SwatchColor=RGB(54, 54, 54))
ln = Line(StartPoint=pt_6, EndPoint=pt_5)
preview = CustomPreview(Geometry=ln, Material=main_color)
tag = TextTag3D(Location=pt_5, Text=split_5.ListA, Size=Slider(0.1, range=0..0.1), Colour=main_color, Justification=7)
tag_2 = TextTag3D(Location=pt_7, Text=concat_2, Size=Slider(0.15, range=0..1), Colour=main_color, Justification=7)
preview_2 = CustomPreview(Geometry=wires, Material=main_color)

# ==== cluster FindEPDIndex
data_to_search = ClusterInput()
data_to_search_2 = Data(data_to_search)
text = ClusterInput()
concatenate = Concatenate(FragmentA="*", FragmentB=text, FragmentA_2="*")
match_text = MatchText(Text=data_to_search_2, Pattern=concatenate, Case=Toggle(False))
dispatch = Dispatch(List=data_to_search_2, DispatchPattern=match_text)  # -> ListA, ListB
item_index = ItemIndex(List=data_to_search_2, Item=dispatch.ListA)
index = ClusterOutput(item_index)
